# Grasshopper definition FlatFinalTest.gh (Grasshopper 1.0.7)
# plug-ins: EasyRobot

kuka_kr6_r900 = KUKA_KR6_R900()  # -> Data, Model
pt = Point([Point(712, -64, 207), Point(732, 31, 207), Point(653, -132, 87), Point(628, 178, 87)])
pt_2 = Point(Point(133, -15, 7))
flac = FlatCore(TargetPoints=pt, Robot=kuka_kr6_r900.Data, Tool=pt_2)
mesh = Mesh(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)
movs = MoveSimulation(
    _6AxisAngles=flac,
    RobotData=kuka_kr6_r900.Data,
    RobotModel=kuka_kr6_r900.Model,
    ToolModel=mesh,
    SimRatio=Slider(1, range=0..1),
    Path="F:\github\myrepo\rhino\EasyRobot\test\test11.src")  # -> AxisAngles, RobotArmLine, RobotArmModel
