# Grasshopper definition SimuTest.gh (Grasshopper 1.0.7)
# plug-ins: EasyRobot

vec = VectorXYZ(XComponent=Slider(62, range=0..100), YComponent=Slider(58, range=0..100), ZComponent=Slider(97, range=0..100))  # -> Vector, Length
pln = Plane(Plane(origin=(507, -179, 0), x=(1, 0, 0), y=(0, -1, 0)))
kuka_kr6_r900 = KUKA_KR6_R900()  # -> Data, Model
move = Move(Geometry=pln, Motion=vec.Vector)  # -> Geometry, Transform
pln_2 = Plane(Plane(origin=(133, -15, 7), x=(0, 0, -1), y=(0, 1, 0)))
pln_3 = Plane([Plane(origin=(653, -132, 87), x=(-0.6299213949, -0.3108702988, -0.7117293682), y=(-0.4003669101, -0.6552772255, 0.6405607661)), Plane(origin=(712, -64, 207), x=(-0.7722852426, -0.2785743197, -0.5709394472), y=(-0.4315331328, -0.4295105001, 0.7932842401)), Plane(origin=(628, 178, 87), x=(-0.06185102254, 0.9838178272, -0.1681574675), y=(0.9175188593, -0.01026932609, -0.3975596606)), Plane(origin=(732, 31, 207), x=(-0.1737692787, 0.9090877002, -0.3786341125), y=(0.5178224462, 0.4113877244, 0.750080032))])
frec = FreeCore(TargetPlanes=pln_3, Robot=kuka_kr6_r900.Data, ToolPlane=pln_2)
mesh = Mesh(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)
panel = Panel(frec)
movs = MoveSimulation(
    _6AxisAngles=frec,
    RobotData=kuka_kr6_r900.Data,
    RobotModel=kuka_kr6_r900.Model,
    ToolModel=mesh,
    SimRatio=Slider(0.872, range=0..1),
    Path="F:\github\myrepo\rhino\EasyRobot\test\test13.src")  # -> AxisAngles, RobotArmLine, RobotArmModel
panel_2 = Panel(movs.AxisAngles)
merge = Merge(
    Data1=Slider(35, range=-100..100),
    Data2=Slider(-18, range=-100..100),
    Data3=Slider(24, range=-100..100),
    Data4=Slider(-7, range=-100..100),
    Data5=Slider(31, range=-100..100),
    Data6=Slider(46, range=-100..100))
